# Grasshopper definition 1 - Column with Point Load.gh (Grasshopper 1.0.8)
# plug-ins: Alpaca4d

height_of_column_m = Slider(4.658, range=0..10)
number_of_nodes = Slider(10, range=2..10)
base_of_column = Panel("0,0,0")

# ----
# Cross Section Dimensions
l_m = Slider(0.3, range=0..1)
w_m = Slider(0.2, range=0..1)

applied_load_n = Slider(100, range=1..100)
line = LineSDL(Start=base_of_column, Direction=Vector(0, 0, 1), Length=height_of_column_m)
divide = DivideCurve(Curve=line, Count=number_of_nodes, Kinks=False)  # -> Points, Tangents, Parameters
curvepoint = PointOnCurve(line, parameter=1)
X = UnitX(Factor=applied_load_n)
multiplication = Multiplication(A=line, B=curvepoint)
linear_time_series = LinearTimeSeriesAlpaca4d(LinearFactor=1)  # -> TimeSeries, Graph
shatter = Shatter(Curve=line, Parameters=divide.Parameters)
rectanglecs = RectangleCSAlpaca4d(SectionName="RecCol", Width=l_m, Height=w_m)
dist = Distance(PointA=multiplication, PointB=base_of_column)
point_load = PointLoadAlpaca4d(Point=curvepoint, Force=X, Moment=Vector(0, 0, 0))
distance_of_load_from_base_m = Panel(dist)
load_pattern = LoadPatternAlpaca4d(TimeSeries=linear_time_series.TimeSeries, Loads=point_load, Factor=1, mode="PlainPattern (Alpaca4d)")
force_beam_column = ForceBeamColumnAlpaca4d(Line=shatter, Section=rectanglecs)
support = SupportAlpaca4d(Point=base_of_column, Tx=True, Ty=True, Tz=True, Rx=True, Ry=True, Rz=True)
assemble_model = AssembleModelAlpaca4d(Elements=force_beam_column, Supports=support, LoadPatterns=load_pattern, Tolerance=0.01)  # -> AlpacaModel, Mass
analysis_settings = AnalysisSettingsAlpaca4d(Constraint="Transformation", Numberer="RCM", System="SparseSPD", Algorithm="ModifiedNewton", AnalysisType="Static")
run_analysis = RunAnalysisAlpaca4d(AlpacaModel=assemble_model.AlpacaModel, Settings=analysis_settings, settings=True)  # -> Log, AlpacaModel
deformation_scale = Slider(10, range=1..10)
nodal_displacements = NodalDisplacementsAlpaca4d(AlpacaModel=run_analysis.AlpacaModel, History=False, Step=0)  # -> Displacement, Rotation, port, Velocity, Acceleration
deformed_model_view = DeformedModelViewAlpaca4d(AlpacaModel=run_analysis.AlpacaModel, Step=0, Scale=deformation_scale)  # -> Beam, Shell, Brick
panel = Panel(nodal_displacements.Displacement)
legend = LegendAlpaca4d(
    Title="Displacement",
    Data=nodal_displacements.Displacement,
    Position=Slider(0, range=0..2),
    Scale=Slider(0.8, range=0..1))

# ----
# Deformed Shape
u = Deconstruct(Point=nodal_displacements.Displacement)  # -> XComponent, YComponent, ZComponent
X_2 = UnitX(Factor=u.XComponent)
move = Move(Geometry=divide.Points, Motion=X_2)  # -> Geometry, Transform
pline = PolyLine(Vertices=move.Geometry, Closed=False)
