# Grasshopper definition 2 - Beam with UD Load.gh (Grasshopper 1.0.8)
# plug-ins: Alpaca4d

length_of_beam_m = Slider(25, range=0..100)
number_of_nodes = Slider(10, range=2..10)
X = UnitX(Factor=1)
pt = Point(Point(0, 0, 0))
line = LineSDL(Start=pt, Direction=X, Length=length_of_beam_m)
width_of_beam_m = Slider(0.3, range=0..1)
depth_of_beam_m = Slider(0.3, range=0..1)
material_library_elastic = MaterialLibraryElasticAlpaca4d(
    MaterialPresetElastic_Grade="S235",
    MaterialPresetElastic_Model="Uniaxial",
    MaterialPresetElastic_Type="Steel",
    menu=[dropdown(0), dropdown(0), dropdown(0)])
divide = DivideCurve(Curve=line, Count=number_of_nodes, Kinks=False)  # -> Points, Tangents, Parameters
udl_kn_m = Slider(1, range=0.1..1)
shatter = Shatter(Curve=line, Parameters=divide.Parameters)
rectanglecs = RectangleCSAlpaca4d(SectionName="BeamSec", Width=width_of_beam_m, Height=depth_of_beam_m, Material=material_library_elastic)
restrain = BooleanToggle(True)
free = BooleanToggle(False)
end = EndPoints(Curve=line)  # -> Start, End
force_beam_column = ForceBeamColumnAlpaca4d(Line=shatter, Section=rectanglecs)
support = SupportAlpaca4d(Point=end.Start, Tx=restrain, Ty=restrain, Tz=restrain, Rx=restrain, Ry=restrain, Rz=restrain)
support_2 = SupportAlpaca4d(Point=end.End, Tx=free, Ty=restrain, Tz=free, Rx=free, Ry=free, Rz=free)
Y = UnitY(Factor=expr("-x", udl_kn_m))
linear_time_series = LinearTimeSeriesAlpaca4d(LinearFactor=1)  # -> TimeSeries, Graph
linearload = LinearLoadAlpaca4d(BeamElement=force_beam_column, Force=Y)
load_pattern = LoadPatternAlpaca4d(TimeSeries=linear_time_series.TimeSeries, Loads=linearload, Factor=1, mode="PlainPattern (Alpaca4d)")
assemble_model = AssembleModelAlpaca4d(Elements=force_beam_column, Supports=[support, support_2], LoadPatterns=load_pattern, Tolerance=0.01)  # -> AlpacaModel, Mass
view = BooleanToggle(True)
analysis_settings = AnalysisSettingsAlpaca4d(Constraint="Transformation", Numberer="RCM", System="SparseSPD", Algorithm="ModifiedNewton", AnalysisType="Static")
modelview = ModelViewAlpaca4d(
    AlpacaModel=assemble_model.AlpacaModel,
    Extruded=view,
    Load=False,
    LoadFactor=1,
    Support=view,
    SupportFactor=1,
    Constraint=False)  # -> AlpacaModel, Info
run_analysis = RunAnalysisAlpaca4d(AlpacaModel=assemble_model.AlpacaModel, Settings=analysis_settings, settings=True)  # -> Log, AlpacaModel
panel = Panel(modelview.Info)
nodal_displacements = NodalDisplacementsAlpaca4d(AlpacaModel=run_analysis.AlpacaModel, History=False, Step=0)  # -> Displacement, Rotation, port, Velocity, Acceleration
reaction_forces = ReactionForcesAlpaca4d(AlpacaModel=run_analysis.AlpacaModel, History=False, Step=0)  # -> SupportPosition, ReactionForce, ReactionMoment
deformed_model_view = DeformedModelViewAlpaca4d(AlpacaModel=run_analysis.AlpacaModel, Step=0, Scale=Slider(228, range=1..1000))  # -> Beam, Shell, Brick
support_reactions = Panel(reaction_forces.ReactionForce)
legend = LegendAlpaca4d(Title="Displacement", Data=nodal_displacements.Displacement, Position=0, Scale=Slider(0.6, range=0.1..1))
